# Grasshopper definition Input Output.gh (Grasshopper 1.0.7)

crv = Curve([<curve referenced from the Rhino model> x18])
path = FilePath("C:\Users\Chee Meng\OneDrive - National University of Singapore\NUS\Y3ST\Type0\Building a Timber House\Generative Layouts\Slicing Floorplan Optimisation\output.txt")
plotheight = Slider(15000, range=1..50000)
aspectratioinfluence = Slider(0.99, range=0..0.99)
plotwidth = Slider(6000, range=1..50000)
epsilon = Slider(0.1, range=1e-06..1)
r = Slider(0.9, range=0..0.99)
k = Slider(10, range=0..100)
P = Slider(0.95, range=0..0.999)
file = ReadFile(File=path, PerLineParse=True)
explode = Explode(Curve=crv, Recursive=True)  # -> Segments, Vertices
item = ListItem(List=explode.Segments, Index=[0, 1], Wrap=True)
split = TextSplit(Text=file, Separators=" ")
len = Length(Curve=item)
panel = Panel(split)
int = Integer(len)
txt = Text(" ")
txt_2 = Text(" ")
txt_3 = Text(" ")
join = TextJoin(Text=int, Join=txt)
join_2 = TextJoin(Text=[plotwidth, plotheight, aspectratioinfluence], Join=txt_2)
join_3 = TextJoin(Text=[P, epsilon, r, k], Join=txt_3)
split_2 = SplitList(List=panel, Index=1)  # -> ListA, ListB
lng = ListLength(List=flatten(join))
split_3 = SplitList(List=split_2.ListB, Index=1)  # -> ListA, ListB
xy = XYPlane(Origin=split_2.ListA)
rectangle = Rectangle(Plane=xy, XSize=split_3.ListA, YSize=split_3.ListB, Radius=0)  # -> Rectangle, Length
panel_2 = Panel([join, join_3, join_2, lng])
